% Simulink data dictionary FuelGaugingData.sldd

AttitudeBus = Simulink.Bus()  % Aircraft attitude
  pitch_deg: double, Unit="deg"  % Aircraft pitch angle
  roll_deg: double, Unit="deg"  % Aircraft roll angle

ProbeReadingBus = Simulink.Bus()  % Single probe measurement output
  probe_height: double, Unit="in"  % Wetted height on probe
  fuel_wl: double, Unit="in"  % Fuel surface waterline at probe
  is_valid: boolean  % True if reading passed health checks
  failure_code: uint8  % 0=OK, 1=OpenCkt, 2=ShortCkt, 3=RateExceed, 4=Stale

BIT_StatusBus = Simulink.Bus()  % Built-in test status for all probes
  all_probes_healthy: boolean
  num_failed_probes: uint8
  failure_flags: boolean[5]
  failure_codes: uint8[5]

TankIndicationBus = Simulink.Bus()  % Per-tank fuel quantity indication
  volume_in3: double, Unit="in^3"
  volume_gal: double, Unit="gal"
  weight_lb: double, Unit="lb"
  probe_data: Bus: ProbeReadingBus
  tank_id: uint8

SystemIndicationBus = Simulink.Bus()  % Complete system fuel quantity indication
  total_weight_lb: double, Unit="lb"
  total_volume_gal: double, Unit="gal"
  density_system: double, Unit="lb/gal"
  bit_status: Bus: BIT_StatusBus

RefuelStatusBus = Simulink.Bus()  % Single-point refuel system status
  is_active: boolean
  is_complete: boolean
  valve_positions: double[5]
  hi_level_states: boolean[5]
  flow_rates_gpm: double[5], Unit="gal/min"
  total_delivered_gal: double, Unit="gal"

IN3_PER_GAL = Simulink.Parameter(231, DataType="double", Unit="in^3/gal")  % Cubic inches per US gallon
ULLAGE_FRAC = Simulink.Parameter(0.02, DataType="double")  % Ullage expansion reserve fraction
UNUSABLE_FRAC = Simulink.Parameter(0.015, DataType="double")  % Unusable fuel fraction
DENSITY_MODEL_A = Simulink.Parameter(4.667, DataType="double", Unit="lb/(gal)")  % Density model slope
DENSITY_MODEL_B = Simulink.Parameter(-2.857, DataType="double", Unit="lb/gal")  % Density model intercept
DENSITY_BIAS = Simulink.Parameter(1.003, DataType="double")  % Density bias multiplier (0.3% high)
KAPPA_NOMINAL = Simulink.Parameter(2.05, DataType="double")  % Nominal fuel dielectric constant
DENSITY_LAB = Simulink.Parameter(6.71, DataType="double", Unit="lb/gal")  % Lab-measured fuel density
PROBE_NOISE_STD = Simulink.Parameter(0.02, DataType="double", Unit="in")  % Probe measurement noise sigma
SUPPLY_PRESSURE_PSI = Simulink.Parameter(55, DataType="double", Unit="psi")  % Refuel supply pressure
MANIFOLD_WL = Simulink.Parameter(78, DataType="double", Unit="in")  % Refuel manifold waterline
MAX_FLOW_GPM = Simulink.Parameter(60, DataType="double", Unit="gal/min")  % Max total refuel flow rate
VALVE_CAPACITY_GPM = Simulink.Parameter(15, DataType="double", Unit="gal/min")  % Per-valve max flow rate
VALVE_CLOSE_TIME = Simulink.Parameter(0.5, DataType="double", Unit="s")  % Shutoff valve close time
VALVE_OPEN_TIME = Simulink.Parameter(0.3, DataType="double", Unit="s")  % Shutoff valve open time
FAILURE_OPEN_THRESH = Simulink.Parameter(-0.1, DataType="double", Unit="in")  % Open circuit threshold
FAILURE_SHORT_MARGIN = Simulink.Parameter(0.5, DataType="double", Unit="in")  % Short circuit margin above max
FAILURE_RATE_THRESH = Simulink.Parameter(2, DataType="double", Unit="in/s")  % Rate exceedance threshold
FAILURE_STALE_TIMEOUT = Simulink.Parameter(30, DataType="double", Unit="s")  % Stale data timeout
FAILURE_STALE_DELTA = Simulink.Parameter(0.01, DataType="double", Unit="in")  % Stale data minimum change
BLEND_LO_WL = Simulink.Parameter(90, DataType="double", Unit="in")  % T3 blend zone lower bound
BLEND_HI_WL = Simulink.Parameter(92, DataType="double", Unit="in")  % T3 blend zone upper bound
PSEUDO_DX = Simulink.Parameter(55, DataType="double", Unit="in")  % T5 pseudo FS offset from T3
PSEUDO_DY = Simulink.Parameter(0, DataType="double", Unit="in")  % T5 pseudo BL offset from T3

TankParams = Simulink.Parameter([struct(
  name="Forward",
  tank_id=uint8(1),
  fs_min=195,
  fs_max=225,
  bl_min=-15,
  bl_max=15,
  wl_min=88,
  wl_max=104,
  base_area=900,
  height=16,
  probe_base=88.24,
  probe_top=103.68,
  lower_base=NaN,
  lower_top=NaN,
  upper_base=NaN,
  upper_top=NaN,
  max_fill=103.68,
  probe_type=uint8(1)), struct(
  name="Left",
  tank_id=uint8(2),
  fs_min=235,
  fs_max=285,
  bl_min=-62,
  bl_max=-22,
  wl_min=85,
  wl_max=103,
  base_area=2000,
  height=18,
  probe_base=85.27,
  probe_top=102.64,
  lower_base=NaN,
  lower_top=NaN,
  upper_base=NaN,
  upper_top=NaN,
  max_fill=102.64,
  probe_type=uint8(1)), struct(
  name="Center",
  tank_id=uint8(3),
  fs_min=235,
  fs_max=285,
  bl_min=-20,
  bl_max=20,
  wl_min=80,
  wl_max=100,
  base_area=2000,
  height=20,
  probe_base=80.3,
  probe_top=99.6,
  lower_base=80.3,
  lower_top=92,
  upper_base=90,
  upper_top=99.6,
  max_fill=99.6,
  probe_type=uint8(2)), struct(
  name="Right",
  tank_id=uint8(4),
  fs_min=235,
  fs_max=285,
  bl_min=22,
  bl_max=62,
  wl_min=85,
  wl_max=103,
  base_area=2000,
  height=18,
  probe_base=85.27,
  probe_top=102.64,
  lower_base=NaN,
  lower_top=NaN,
  upper_base=NaN,
  upper_top=NaN,
  max_fill=102.64,
  probe_type=uint8(1)), struct(
  name="Aft",
  tank_id=uint8(5),
  fs_min=295,
  fs_max=335,
  bl_min=-17.5,
  bl_max=17.5,
  wl_min=83,
  wl_max=105,
  base_area=1400,
  height=22,
  probe_base=83,
  probe_top=105,
  lower_base=NaN,
  lower_top=NaN,
  upper_base=NaN,
  upper_top=NaN,
  max_fill=104.56,
  probe_type=uint8(3))], DataType="struct")  % Per-tank geometric and probe parameters (1x5 struct array)

LUT_T1 = Simulink.LookupTable(
  Table=Simulink.lookuptable.Table(
    Value=reshape([218.3033 364.4114 562.7292 814.4114 1118.303 1467.631 1853.935 2268.75 2703.616 3150.07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], 37, 13, 17),
    Dimensions=[37 13 17],
    DataType="double",
    FieldName="Table"),
  BreakpointsSpecification="Explicit values",
  Breakpoints=[Simulink.lookuptable.Breakpoint(
    Value=[-1.24 -0.74 -0.24 0.26 0.76 1.26 1.76 2.26 2.76 3.26 3.76 4.26 4.76 5.26 5.76 6.26 6.76 7.26 7.76 8.26 8.76 9.26 9.76 10.26 10.76 11.26 11.76 12.26 12.76 13.26 13.76 14.26 14.76 15.26 15.76 16.26 16.76],
    TunableSizeName="N1",
    TunableSizeValue=-1,
    Dimensions=[1 37],
    DataType="double",
    FieldName="BP1"), Simulink.lookuptable.Breakpoint(
    Value=[-6 -5 -4 -3 -2 -1 0 1 2 3 4 5 6],
    TunableSizeName="N2",
    TunableSizeValue=-1,
    Dimensions=[1 13],
    DataType="double",
    FieldName="BP2"), Simulink.lookuptable.Breakpoint(
    Value=[-8 -7 -6 -5 -4 -3 -2 -1 0 1 2 3 4 5 6 7 8],
    TunableSizeName="N3",
    TunableSizeValue=-1,
    Dimensions=[1 17],
    DataType="double",
    FieldName="BP3")],
  AllowMultipleInstancesOfTypeToHaveDifferentTableBreakpointSizes=false)

LUT_T2 = Simulink.LookupTable(
  Table=Simulink.lookuptable.Table(
    Value=reshape([986.4587 1358.827 1814.707 2358.827 2986.459 3689.211 4458.617 5286.218 6163.548 7082.15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], 41, 13, 17),
    Dimensions=[41 13 17],
    DataType="double",
    FieldName="Table"),
  BreakpointsSpecification="Explicit values",
  Breakpoints=[Simulink.lookuptable.Breakpoint(
    Value=[-1.27 -0.77 -0.27 0.23 0.73 1.23 1.73 2.23 2.73 3.23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 18.73],
    TunableSizeName="N1",
    TunableSizeValue=-1,
    Dimensions=[1 41],
    DataType="double",
    FieldName="BP1"), Simulink.lookuptable.Breakpoint(
    Value=[-6 -5 -4 -3 -2 -1 0 1 2 3 4 5 6],
    TunableSizeName="N2",
    TunableSizeValue=-1,
    Dimensions=[1 13],
    DataType="double",
    FieldName="BP2"), Simulink.lookuptable.Breakpoint(
    Value=[-8 -7 -6 -5 -4 -3 -2 -1 0 1 2 3 4 5 6 7 8],
    TunableSizeName="N3",
    TunableSizeValue=-1,
    Dimensions=[1 17],
    DataType="double",
    FieldName="BP3")],
  AllowMultipleInstancesOfTypeToHaveDifferentTableBreakpointSizes=false)

LUT_T3 = Simulink.LookupTable(
  Table=Simulink.lookuptable.Table(
    Value=reshape([963.2188 1330.03 1779.796 2317.769 2939.802 3637.551 4402.548 5226.337 6100.45 7016.429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], 45, 13, 17),
    Dimensions=[45 13 17],
    DataType="double",
    FieldName="Table"),
  BreakpointsSpecification="Explicit values",
  Breakpoints=[Simulink.lookuptable.Breakpoint(
    Value=[-1.3 -0.8 -0.3 0.2 0.7 1.2 1.7 2.2 2.7 3.2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 20.7],
    TunableSizeName="N1",
    TunableSizeValue=-1,
    Dimensions=[1 45],
    DataType="double",
    FieldName="BP1"), Simulink.lookuptable.Breakpoint(
    Value=[-6 -5 -4 -3 -2 -1 0 1 2 3 4 5 6],
    TunableSizeName="N2",
    TunableSizeValue=-1,
    Dimensions=[1 13],
    DataType="double",
    FieldName="BP2"), Simulink.lookuptable.Breakpoint(
    Value=[-8 -7 -6 -5 -4 -3 -2 -1 0 1 2 3 4 5 6 7 8],
    TunableSizeName="N3",
    TunableSizeValue=-1,
    Dimensions=[1 17],
    DataType="double",
    FieldName="BP3")],
  AllowMultipleInstancesOfTypeToHaveDifferentTableBreakpointSizes=false)

LUT_T4 = Simulink.LookupTable(
  Table=Simulink.lookuptable.Table(
    Value=reshape([986.4587 1358.827 1814.707 2358.827 2986.459 3689.211 4458.617 5286.218 6163.548 7082.15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], 41, 13, 17),
    Dimensions=[41 13 17],
    DataType="double",
    FieldName="Table"),
  BreakpointsSpecification="Explicit values",
  Breakpoints=[Simulink.lookuptable.Breakpoint(
    Value=[-1.27 -0.77 -0.27 0.23 0.73 1.23 1.73 2.23 2.73 3.23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 18.73],
    TunableSizeName="N1",
    TunableSizeValue=-1,
    Dimensions=[1 41],
    DataType="double",
    FieldName="BP1"), Simulink.lookuptable.Breakpoint(
    Value=[-6 -5 -4 -3 -2 -1 0 1 2 3 4 5 6],
    TunableSizeName="N2",
    TunableSizeValue=-1,
    Dimensions=[1 13],
    DataType="double",
    FieldName="BP2"), Simulink.lookuptable.Breakpoint(
    Value=[-8 -7 -6 -5 -4 -3 -2 -1 0 1 2 3 4 5 6 7 8],
    TunableSizeName="N3",
    TunableSizeValue=-1,
    Dimensions=[1 17],
    DataType="double",
    FieldName="BP3")],
  AllowMultipleInstancesOfTypeToHaveDifferentTableBreakpointSizes=false)

LUT_T5 = Simulink.LookupTable(
  Table=Simulink.lookuptable.Table(
    Value=reshape([509.6917 755.9161 1070.37 1455.916 1909.692 2423.744 2989.612 3598.832 4242.944 4913.484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], 49, 13, 17),
    Dimensions=[49 13 17],
    DataType="double",
    FieldName="Table"),
  BreakpointsSpecification="Explicit values",
  Breakpoints=[Simulink.lookuptable.Breakpoint(
    Value=[-1 -0.5 0 0.5 1 1.5 2 2.5 3 3.5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 23],
    TunableSizeName="N1",
    TunableSizeValue=-1,
    Dimensions=[1 49],
    DataType="double",
    FieldName="BP1"), Simulink.lookuptable.Breakpoint(
    Value=[-6 -5 -4 -3 -2 -1 0 1 2 3 4 5 6],
    TunableSizeName="N2",
    TunableSizeValue=-1,
    Dimensions=[1 13],
    DataType="double",
    FieldName="BP2"), Simulink.lookuptable.Breakpoint(
    Value=[-8 -7 -6 -5 -4 -3 -2 -1 0 1 2 3 4 5 6 7 8],
    TunableSizeName="N3",
    TunableSizeValue=-1,
    Dimensions=[1 17],
    DataType="double",
    FieldName="BP3")],
  AllowMultipleInstancesOfTypeToHaveDifferentTableBreakpointSizes=false)